# Grasshopper definition 2016-2-01_SCRIPT DE DESPIECE.gh (Grasshopper 0.9.76)
# plug-ins: PTComponentLibrary

geo = Geometry([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])
boxprop = BoxProperties(Box=geo)  # -> Center, Diagonal, Area, Volume, Degeneracy
bbox = BoundingBox(Content=geo, Plane=PlaneXY(0, 0, 0), UnionBox=True)  # -> Box, Box_2
boxprop_2 = BoxProperties(Box=bbox.Box)  # -> Center, Diagonal, Area, Volume, Degeneracy
bnd = Bounds(Numbers=boxprop.Diagonal)
lng = ListLength(List=geo)
pdecon = Deconstruct(Point=boxprop_2.Center)  # -> XComponent, YComponent, ZComponent
_0 = Number(0)
dedomain = DeconstructDomain(Domain=bnd)  # -> Start, End
pt = ConstructPoint(XCoordinate=pdecon.XComponent, YCoordinate=pdecon.YComponent, ZCoordinate=_0)
panel = Panel(dedomain.End)
num = Number(dedomain.End)
sqrt = SquareRoot(Value=lng)
series = Series(Start=0, Step=1, Count=lng)
round = Round(Number=sqrt)  # -> Nearest, Floor, Ceiling
ptplanar = PlanarGrid(
    BasePoint=pt,
    IDir=Vector(1, 0, 0),
    JDir=Vector(0, 1, 0),
    IDistance=num,
    JDistance=num,
    INumber=round.Ceiling,
    JNumber=round.Ceiling)  # -> flatten(Grid)
item = ListItem(List=ptplanar, Index=series, Wrap=True)
vec2pt = Vector2Pt(PointA=boxprop.Center, PointB=item, Unitize=False)  # -> Vector, Length
move = Move(Geometry=geo, Motion=vec2pt.Vector)  # -> Geometry, Transform
debrep = DeconstructBrep(Brep=move.Geometry)  # -> Faces, Edges, Vertices
boxprop_3 = BoxProperties(Box=move.Geometry)  # -> Center, Diagonal, Area, Volume, Degeneracy
plfit = PlaneFit(Points=debrep.Vertices)  # -> flatten(Plane), Deviation
xy = XYPlane(Origin=Point(0, 0, 0))
pl_origin = PlaneOrigin(Base=plfit.Plane, Origin=boxprop_3.Center)
pl_origin_2 = PlaneOrigin(Base=xy, Origin=boxprop_3.Center)
orient = Orient(Geometry=move.Geometry, Source=pl_origin, Target=pl_origin_2)  # -> Geometry, Transform
sec = BrepPlane(Brep=orient.Geometry, Plane=PlaneXY(0, 0, 0))  # -> Curves, Points
