# Grasshopper definition 2016-2-01_SCRIPT KERFING UNIDIRECCIONAL CINTA.gh (Grasshopper 0.9.76)

geo = Geometry(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)
geo_2 = Geometry(<brep referenced from the Rhino model>)
debrep = DeconstructBrep(Brep=geo)  # -> Faces, Edges, Vertices
debrep_2 = DeconstructBrep(Brep=geo_2)  # -> Faces, Edges, Vertices
item = ListItem(List=debrep.Edges, Index=0, Wrap=True)  # -> Item, Item1, Item2, Item3
len = Length(Curve=item.Item)
flip = FlipCurve(Curve=item.Item2)  # -> Curve, Flag
_7 = Number(7)
geo_3 = Geometry([item.Item, flip.Curve])
division = Division(A=len, B=_7)
divide = DivideCurve(Curve=geo_3, Count=division, Kinks=False)  # -> Points, Tangents, Parameters
bang = ExplodeTree(Data=divide.Points)  # -> Branch0, Branch1
ln = Line(StartPoint=bang.Branch0, EndPoint=bang.Branch1)
dispatch = Dispatch(List=ln, DispatchPattern=[True, False])  # -> ListA, ListB
curvepoint = PointOnCurve(dispatch.ListB, parameter=0.902)
curvepoint_2 = PointOnCurve(dispatch.ListA, parameter=0.097)
end = EndPoints(Curve=dispatch.ListB)  # -> Start, End
end_2 = EndPoints(Curve=dispatch.ListA)  # -> Start, End
ln_2 = Line(StartPoint=end_2.End, EndPoint=curvepoint_2)
ln_3 = Line(StartPoint=end.Start, EndPoint=curvepoint)
geo_4 = Geometry([debrep.Edges, debrep_2.Edges])
