# Grasshopper definition 2016-2-01_VOLUMEN DE PRUEBA WAFFLE RADIALL.gh (Grasshopper 0.9.76)

# ---- group: BASE-BASE
radio_base_base = Slider(200, range=150..250)
_0 = Number(0)

# ---- group: BASE-MEDIO
radio_base_medio = Slider(120, range=120..180)
altura_base_medio = Slider(206, range=200..300)

# ---- group: ASIENTO
radio_asiento = Slider(250, range=200..300)
altura_asiento = Slider(450, range=400..500)

# ----
altura_maxima_espaldar = Slider(550, range=500..600)

# ---- group: BASE-ALTO
subtraction = Subtraction(A=altura_asiento, _55=55)
subtraction_2 = Subtraction(A=radio_asiento, _70=70)

# ---- group: ASIENTO-BASE
addition = Addition(A=radio_asiento, _30=30)
num = Number(subtraction)

# ----
_0_2 = Number(0)
num_2 = Number([_0, altura_base_medio, subtraction, num, altura_asiento])
pt = ConstructPoint(XCoordinate=_0_2, YCoordinate=_0_2, ZCoordinate=num_2)
num_3 = Number([radio_base_base, radio_base_medio, subtraction_2, addition, radio_asiento])
diámetros = Panel(num_3)
xy = XYPlane(Origin=pt)
alturas = Panel(num_2)
cir = Circle(Plane=xy, Radius=num_3)
item = ListItem(List=cir, Index=0, Wrap=True)  # -> Item, Item1, Item2, Item3, Item4
loft = Loft(
    Curves=[item.Item, item.Item1, item.Item2],
    Options={Adjust=False, Closed=False, LoftEnds=0, LoftSimp=0, LoftType=2, Rebuild=10, Refit=0.01})
loft_2 = Loft(
    Curves=[item.Item2, item.Item3, item.Item4],
    Options={Adjust=False, Closed=False, LoftEnds=0, LoftSimp=0, LoftType=3, Rebuild=10, Refit=0.01})
join = BrepJoin(Breps=[loft, loft_2])  # -> Breps, Closed
cap = CapHoles(Brep=join.Breps)
