# Grasshopper definition 2016-2-01_WAFFLE RADIAL.gh (Grasshopper 0.9.76)

sesgo_de_distribución_de_piezas_horitzon = Slider(0.5, range=0..1)  # "sesgo de distribución de piezas horitzontales"

diámetro_cilindro_hueco_central_mm = Slider(100, range=0..100)
número_horizontales = Slider(8, range=0..11)
diámetro_fresadora_mm = Slider(6.35, range=0..10)
espesor_material = Slider(9, range=6..15)
número_radios = Slider(15, range=1..23)

geometría_base = Geometry(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)
definición_waffle_radial_sólido_v0_9 = DefiniciónWaffleRadialSólidoV09(
    horizontal_distribution_bias=sesgo_de_distribución_de_piezas_horitzon,
    número_horizontales=número_horizontales,
    diámetro_de_la_fresadora=diámetro_fresadora_mm,
    geometría_base=geometría_base,
    espesor_material=espesor_material,
    número_de_radios=número_radios,
    radio_del_cilindro_hueco_del_centro=diámetro_cilindro_hueco_central_mm)  # -> horizontales, horizontales_para_fresa, radiales_para_fresa, radios

# ---- group: LASER
horizontales = Geometry(definición_waffle_radial_sólido_v0_9.horizontales)
radiales = Geometry(definición_waffle_radial_sólido_v0_9.radios)

# ---- group: CRC
horizontales_2 = Geometry(definición_waffle_radial_sólido_v0_9.horizontales_para_fresa)
radiales_2 = Geometry(definición_waffle_radial_sólido_v0_9.radiales_para_fresa)

# ==== cluster DefiniciónWaffleRadialSólidoV09
geometría_base = ClusterInput()
espesor_material = ClusterInput()
número_de_radios = ClusterInput()
radio_del_cilindro_hueco_del_centro = ClusterInput()  # Radio del cilindro interno del hueco. Debe ser siempre mayor al producto del número de radios y el espesor del material
geo = Geometry(geometría_base)
panel = Panel(número_de_radios)
horizontal_distribution_bias = ClusterInput()  # ¿Qué tan lejos quedan las piezas horizontales de los límites superior e inferior del volumen?
número_horizontales = ClusterInput()
num = Number(horizontal_distribution_bias)

# ---- group: PLANOS RADIALES / CIRCUNFERENCIA MINIMA DEL CILINDRO INTERIOR
# Si Int.R es menor que el radio mínimo del cilindro interior, el radio total igual crece.
# 
# Se propriza que funcione el algoritmo.
multiplication = Multiplication(A=espesor_material, B=número_de_radios)

# ----
panel_2 = Panel(número_horizontales)

# ---- group: PLANOS RADIALES / RADIO MINIMO DEL CILINDRO INTERIOR
division = Division(A=multiplication, B=6.283185307)

# ----
subtraction = Subtraction(A=radio_del_cilindro_hueco_del_centro, B=division)

# ---- group: RADIO DEL CILINDRO
abs = Absolute(Value=subtraction)

# ----
panel_3 = Panel(abs)
Z = UnitZ(Factor=expr("-x/2", espesor_material))
diámetro_de_la_fresadora = ClusterInput()

# ---- group: PLANOS RADIALES
debox = DeconstructBox(Box=geo)  # -> Plane, X, Y, Z
boxprop = BoxProperties(Box=geo)  # -> Center, Diagonal, Area, Volume, Degeneracy
Z_2 = UnitZ(Factor=debox.Z)

# ---- group: PLANOS RADIALES / PUNTOS MINIMO Y MAXIMO EN Z
dedomain = DeconstructDomain(Domain=debox.Z)  # -> Start, End

# ----
subtraction_2 = Subtraction(A=dedomain.End, B=dedomain.Start)
division_2 = Division(A=subtraction_2, B=2)

# ---- group: CONTOUR HORIZONTALES / DIMENSION EN Z DIVIDIDA SIN BIAS
addition = Addition(A=número_horizontales, B=1)
division_3 = Division(A=subtraction_2, B=addition)

# ---- group: PLANOS RADIALES (continued)
Z_3 = UnitZ(Factor=expr("-x", division_2))
move = Move(Geometry=boxprop.Center, Motion=Z_3)  # -> Geometry, Transform
xy = XYPlane(Origin=move.Geometry)

# ---- group: PLANOS RADIALES / MOVER EL PUNTO DEL CENTRO EN X UNA DISTANCIA MAYOR AL PUNTO MÁS LEJANO DEL VOLUMEN
X = UnitX(Factor=boxprop.Diagonal)
move_2 = Move(Geometry=move.Geometry, Motion=X)  # -> Geometry, Transform

# ---- group: PLANOS RADIALES / MOVER EL PUNTO DEL CENTRO EN X LA DISTANCIA CORRESPONDIENTE AL RADIO DEL CILINDRO HUECO DEL CENTRO
X_2 = UnitX(Factor=abs)
move_3 = Move(Geometry=move.Geometry, Motion=X_2)  # -> Geometry, Transform

# ---- group: CONTOUR HORIZONTALES / MOVER PUNTO BASE HACIA ABAJO LA DISTANCIA DE BIAS (bias * la distancia entre dos piezas horizontales sin bias)
multiplication_2 = Multiplication(A=division_3, B=num)
Z_4 = UnitZ(Factor=expr("-x", multiplication_2))
move_4 = Move(Geometry=move.Geometry, Motion=Z_4)  # -> Geometry, Transform

# ---- group: CONTOUR HORIZONTALES / ASEGURAR QUE EL CONTOUR PERMANEZCA CENTRADO EN z
multiplication_3 = Multiplication(A=multiplication_2, B=2)
addition_2 = Addition(A=subtraction_2, B=multiplication_3)
division_4 = Division(A=addition_2, B=addition)

# ---- group: PLANOS RADIALES (continued)
ln = Line(StartPoint=move_3.Geometry, EndPoint=move_2.Geometry)

# ----
ext = ExtendCurve(Curve=ln, Type=0, Start=3, End=3)
simplify = SimplifyCurve(Curve=ext, Tolerance=0.001, AngleTolerance=0.001)  # -> Curve, Simplified

# ---- group: PLANOS RADIALES / PLANOS RADIALES EN BRUTO
extr = Extrude(Base=simplify.Curve, Direction=Z_2)
arrpolar = PolarArray(Geometry=extr, Plane=xy, Count=número_de_radios, Angle=degrees(360))  # -> Geometry, Transform

# ---- group: PLANOS RADIALES / INTERSECCION DE PLANOS RADIALES CON EL VOLUMEN
bbx = BrepBrep(BrepA=arrpolar.Geometry, BrepB=geo)  # -> flatten(Curves), Points
end = EndPoints(Curve=bbx.Curves)  # -> Start, End
ln_2 = Line(StartPoint=end.Start, EndPoint=end.End)
join = JoinCurves(Curves=flatten([ln_2, bbx.Curves]), Preserve=False)

# ---- group: PLANOS RADIALES
boundary = BoundarySurfaces(Edges=join)

# ---- group: VECTORES DE EXTRUSIÓN DE SECCIONES RADIALES
item = ListItem(List=boundary, Index=0, Wrap=True)
Y = UnitY(Factor=expr("x/2", espesor_material))
boxprop_2 = BoxProperties(Box=item)  # -> Center, Diagonal, Area, Volume, Degeneracy
move_5 = Move(Geometry=boxprop_2.Center, Motion=expr("-x", Y))  # -> Geometry, Transform
move_6 = Move(Geometry=boxprop_2.Center, Motion=Y)  # -> Geometry, Transform
ln_3 = Line(StartPoint=boxprop_2.Center, EndPoint=move_6.Geometry)
ln_4 = Line(StartPoint=boxprop_2.Center, EndPoint=move_5.Geometry)
transform = Transform(Geometry=ln_4, Transform=arrpolar.Transform)
transform_2 = Transform(Geometry=ln_3, Transform=arrpolar.Transform)

# ---- group: EXTRUSION DE SECCIONES RADIALES
extrcrv = ExtrudeAlong(Base=boundary, Curve=transform_2)  # -> flatten(Extrusion)
extrcrv_2 = ExtrudeAlong(Base=boundary, Curve=transform)  # -> flatten(Extrusion)
sunion = SolidUnion(Breps=[extrcrv, extrcrv_2])
fmerge = MergeFaces(Brep=sunion)  # -> flatten(Breps), Before, After

# ---- group: CONTOUR HORIZONTALES
contour = Contour(Shape=geo, Point=move_4.Geometry, Direction=Z_3, Distance=division_4)  # -> flatten(Contours)
Z_5 = UnitZ(Factor=espesor_material)

# ---- group: CONTOUR HORIZONTALES / HORADAR EL CENTRO DE CADA POLIGONO
area = Area(Geometry=contour)  # -> Area, Centroid
cir = Circle(Plane=area.Centroid, Radius=abs)
entwine = Entwine(Branch00=contour, Branch01=cir, FlattenInputs=True)
flip = FlipMatrix(Data=entwine)

# ----
panel_4 = Panel(flip)
panel_5 = Panel(entwine)

# ---- group: CONTOUR HORIZONTALES (continued)
boundary_2 = BoundarySurfaces(Edges=flip)  # -> graft(Surfaces)
extr_2 = Extrude(Base=boundary_2, Direction=expr("x/2", Z_5))
extr_3 = Extrude(Base=boundary_2, Direction=expr("-x/2", Z_5))
sunion_2 = SolidUnion(Breps=[extr_2, extr_3])  # -> flatten(Result)

# ---- group: INTERSECCIONES SECCIONES HORIZONTALES Y RADIALES
Z_6 = UnitZ(Factor=expr("-x/2", espesor_material))
bbx_2 = BrepBrep(BrepA=boundary_2, BrepB=boundary)  # -> flatten(Curves), Points
move_7 = Move(Geometry=bbx_2.Curves, Motion=Z_6)  # -> Geometry, Transform
curvepoint = PointOnCurve(move_7.Geometry, parameter=0.496)
end_2 = EndPoints(Curve=move_7.Geometry)  # -> Start, End

# ---- group: ENCASTRES PARA LASER PIEZAS HORIZONTALES
ln_5 = Line(StartPoint=curvepoint, EndPoint=end_2.End)
num_2 = Number(espesor_material)
pl = PlaneNormal(Origin=curvepoint, ZAxis=ln_5)
len = Length(Curve=ln_5)
dom = ConstructDomain(DomainStart=expr("-x/2", num_2), DomainEnd=expr("x/2", num_2))
dom_2 = ConstructDomain(DomainStart=expr("(-x/2)-.1", num_2), DomainEnd=expr("(x/2)+.1", num_2))
amp = Amplitude(Vector=ln_5, Amplitude=expr("x+10", len))
rectangle = Rectangle(Plane=pl, XSize=dom, YSize=dom_2, Radius=0)  # -> Rectangle, Length
extr_4 = Extrude(Base=rectangle.Rectangle, Direction=amp)
cap = CapHoles(Brep=extr_4)

# ---- group: ENCASTRES PARA LASER PIEZAS RADIALES
ln_6 = Line(StartPoint=curvepoint, EndPoint=end_2.Start)
pl_2 = PlaneNormal(Origin=curvepoint, ZAxis=ln_6)
num_3 = Number(espesor_material)
len_2 = Length(Curve=ln_6)
dom_3 = ConstructDomain(DomainStart=expr("-x/2", num_3), DomainEnd=expr("x/2", num_3))
dom_4 = ConstructDomain(DomainStart=expr("(-x/2)-.1", num_3), DomainEnd=expr("(x/2)+.1", num_3))
amp_2 = Amplitude(Vector=ln_6, Amplitude=expr("x+10", len_2))
rectangle_2 = Rectangle(Plane=pl_2, XSize=dom_3, YSize=dom_4, Radius=0)  # -> Rectangle, Length
extr_5 = Extrude(Base=rectangle_2.Rectangle, Direction=amp_2)
cap_2 = CapHoles(Brep=extr_5)

# ---- group: MUESCAS DE FRESADORA PIEZAS RADIALES
debrep = DeconstructBrep(Brep=rectangle_2.Rectangle)  # -> Faces, Edges, Vertices
item_2 = ListItem(List=debrep.Edges, Index=0, Wrap=True)  # -> Item, Item1, Item2, Item3
line = Line([item_2.Item1, item_2.Item3, item_2.Item, item_2.Item2])
flip_2 = FlipMatrix(Data=line)
bang = ExplodeTree(Data=flip_2)  # -> Branch0, Branch1, Branch2, Branch3
pipe = Pipe(Curve=bang.Branch0, Radius=expr("x/2", diámetro_de_la_fresadora), Caps=1)  # -> flatten(Pipe)
pipe_2 = Pipe(Curve=bang.Branch1, Radius=expr("x/2", diámetro_de_la_fresadora), Caps=1)  # -> flatten(Pipe)
pipe_3 = Pipe(Curve=bang.Branch2, Radius=expr("x/2", diámetro_de_la_fresadora), Caps=1)  # -> flatten(Pipe)
pipe_4 = Pipe(Curve=bang.Branch3, Radius=expr("x/2", diámetro_de_la_fresadora), Caps=1)  # -> flatten(Pipe)
amp_3 = Amplitude(Vector=ln_6, Amplitude=expr("(x/2)-.2", diámetro_de_la_fresadora))
entwine_2 = Entwine(Branch00=pipe, Branch01=pipe_2, Branch02=pipe_3, Branch03=pipe_4, FlattenInputs=True)
move_8 = Move(Geometry=entwine_2, Motion=amp_3)  # -> Geometry, Transform

# ----
move_9 = Move(Geometry=sunion_2, Motion=Z)  # -> Geometry, Transform

# ---- group: MUESCAS DE FRESADORA PIEZAS HORIZONTALES
debrep_2 = DeconstructBrep(Brep=rectangle.Rectangle)  # -> Faces, Edges, Vertices
item_3 = ListItem(List=debrep_2.Edges, Index=0, Wrap=True)  # -> Item, Item1, Item2, Item3
line_2 = Line([item_3.Item1, item_3.Item3, item_3.Item, item_3.Item2])
flip_3 = FlipMatrix(Data=line_2)
bang_2 = ExplodeTree(Data=flip_3)  # -> Branch0, Branch1, Branch2, Branch3
pipe_5 = Pipe(Curve=bang_2.Branch0, Radius=expr("x/2", diámetro_de_la_fresadora), Caps=1)  # -> flatten(Pipe)
pipe_6 = Pipe(Curve=bang_2.Branch1, Radius=expr("x/2", diámetro_de_la_fresadora), Caps=1)  # -> flatten(Pipe)
pipe_7 = Pipe(Curve=bang_2.Branch2, Radius=expr("x/2", diámetro_de_la_fresadora), Caps=1)  # -> flatten(Pipe)
pipe_8 = Pipe(Curve=bang_2.Branch3, Radius=expr("x/2", diámetro_de_la_fresadora), Caps=1)  # -> flatten(Pipe)
amp_4 = Amplitude(Vector=ln_5, Amplitude=expr("(x/2)-.2", diámetro_de_la_fresadora))
entwine_3 = Entwine(Branch00=pipe_5, Branch01=pipe_6, Branch02=pipe_7, Branch03=pipe_8, FlattenInputs=True)
move_10 = Move(Geometry=entwine_3, Motion=amp_4)  # -> Geometry, Transform

# ----
panel_6 = Panel(line_2)
panel_7 = Panel(flip_3)
sdiff = SolidDifference(BrepsA=move_9.Geometry, BrepsB=cap)

# ---- group: PIEZAS RADIALES PARA LASER
sdiff_2 = SolidDifference(BrepsA=fmerge.Breps, BrepsB=cap_2)

# ---- group: PIEZAS HORIZONTALES PARA LASER
geo_2 = Geometry(sdiff)

# ----
horizontales = ClusterOutput(geo_2)
radios = ClusterOutput(sdiff_2)
flip_4 = FlipMatrix(Data=move_10.Geometry)
flip_5 = FlipMatrix(Data=move_8.Geometry)
sdiff_3 = SolidDifference(BrepsA=geo_2, BrepsB=flatten(flip_4))
sdiff_4 = SolidDifference(BrepsA=sdiff_2, BrepsB=flatten(flip_5))
horizontales_para_fresa = ClusterOutput(sdiff_3)
radiales_para_fresa = ClusterOutput(sdiff_4)
