# Grasshopper definition 2017-2-01_SCRIPT DESPIECE DE CURVAS.gh (Grasshopper 0.9.76)

# ---- group: ELEMENTOS EN X
geo = Geometry([<curve referenced from the Rhino model> x23])

# ---- group: ELEMENTOS EN Y
geo_2 = Geometry([<curve referenced from the Rhino model> x17])

# ----
geo_3 = Geometry(geo_2)
geo_4 = Geometry(geo)
geo_5 = Geometry(geo)
geo_6 = Geometry(geo_2)

# ---- group: MOVER HASTA 0 EN Z
debox = DeconstructBox(Box=geo_3)  # -> Plane, X, Y, Z
Z = UnitZ(Factor=1)
dedomain = DeconstructDomain(Domain=debox.Z)  # -> Start, End
amp = Amplitude(Vector=Z, Amplitude=expr("-x", dedomain.Start))
move = Move(Geometry=geo_3, Motion=amp)  # -> Geometry, Transform

debox_2 = DeconstructBox(Box=geo_4)  # -> Plane, X, Y, Z
Z_2 = UnitZ(Factor=1)
dedomain_2 = DeconstructDomain(Domain=debox_2.Z)  # -> Start, End
amp_2 = Amplitude(Vector=Z_2, Amplitude=expr("-x", dedomain_2.Start))
move_2 = Move(Geometry=geo_4, Motion=amp_2)  # -> Geometry, Transform

# ---- group: DIMENSION MAXIMA EN X
debox_3 = DeconstructBox(Box=geo_5)  # -> Plane, X, Y, Z
dedomain_3 = DeconstructDomain(Domain=debox_3.X)  # -> Start, End
bnd = Bounds(Numbers=dedomain_3.End)
bnd_2 = Bounds(Numbers=dedomain_3.Start)
dedomain_4 = DeconstructDomain(Domain=bnd)  # -> Start, End
dedomain_5 = DeconstructDomain(Domain=bnd_2)  # -> Start, End
subtraction = Subtraction(A=dedomain_4.End, B=dedomain_5.Start)

debox_4 = DeconstructBox(Box=geo_6)  # -> Plane, X, Y, Z
dedomain_6 = DeconstructDomain(Domain=debox_4.Y)  # -> Start, End
bnd_3 = Bounds(Numbers=dedomain_6.End)
bnd_4 = Bounds(Numbers=dedomain_6.Start)
dedomain_7 = DeconstructDomain(Domain=bnd_3)  # -> Start, End
dedomain_8 = DeconstructDomain(Domain=bnd_4)  # -> Start, End
subtraction_2 = Subtraction(A=dedomain_7.End, B=dedomain_8.Start)

# ---- group: EJES DE ROTACION
boxprop = BoxProperties(Box=geo_3)  # -> Center, Diagonal, Area, Volume, Degeneracy
debox_5 = DeconstructBox(Box=move.Geometry)  # -> Plane, X, Y, Z
dedomain_9 = DeconstructDomain(Domain=debox_5.Z)  # -> Start, End
pdecon = Deconstruct(Point=boxprop.Center)  # -> XComponent, YComponent, ZComponent
pt = ConstructPoint(XCoordinate=pdecon.XComponent, YCoordinate=pdecon.YComponent, ZCoordinate=dedomain_9.Start)
Y = UnitY(Factor=1)
move_3 = Move(Geometry=pt, Motion=Y)  # -> Geometry, Transform
ln = Line(StartPoint=pt, EndPoint=move_3.Geometry)

boxprop_2 = BoxProperties(Box=geo_4)  # -> Center, Diagonal, Area, Volume, Degeneracy
debox_6 = DeconstructBox(Box=move_2.Geometry)  # -> Plane, X, Y, Z
dedomain_10 = DeconstructDomain(Domain=debox_6.Z)  # -> Start, End
pdecon_2 = Deconstruct(Point=boxprop_2.Center)  # -> XComponent, YComponent, ZComponent
X = UnitX(Factor=1)
pt_2 = ConstructPoint(XCoordinate=pdecon_2.XComponent, YCoordinate=pdecon_2.YComponent, ZCoordinate=dedomain_10.Start)
move_4 = Move(Geometry=pt_2, Motion=X)  # -> Geometry, Transform
ln_2 = Line(StartPoint=pt_2, EndPoint=move_4.Geometry)

# ---- group: DISTANCIA A MOVER CADA PIEZA
subtraction_3 = Subtraction(A=dedomain.End, B=dedomain.Start)
bnd_5 = Bounds(Numbers=subtraction_3)
lng = ListLength(List=geo_3)
dedomain_11 = DeconstructDomain(Domain=bnd_5)  # -> Start, expr("1.5*x", End)
series = Series(Start=0, Step=1, Count=lng)
multiplication = Multiplication(A=dedomain_11.End, B=series)
rev = ReverseList(List=multiplication)

subtraction_4 = Subtraction(A=dedomain_2.End, B=dedomain_2.Start)
bnd_6 = Bounds(Numbers=subtraction_4)
lng_2 = ListLength(List=geo_4)
dedomain_12 = DeconstructDomain(Domain=bnd_6)  # -> Start, expr("1.5*x", End)
series_2 = Series(Start=0, Step=1, Count=lng_2)
multiplication_2 = Multiplication(A=dedomain_12.End, B=series_2)
rev_2 = ReverseList(List=multiplication_2)

# ---- group: ROTAR 90 GRADOS ("ACOSTAR")
_90 = Number(90)
rotax = RotateAxis(Geometry=move.Geometry, Angle=degrees(_90), Axis=ln)  # -> Geometry, Transform

_90_2 = Number(-90)
rotax_2 = RotateAxis(Geometry=move_2.Geometry, Angle=degrees(_90_2), Axis=ln_2)  # -> Geometry, Transform

# ---- group: ALEJAR DEL MODELO
addition = Addition(A=rev, B=subtraction)
X_2 = UnitX(Factor=1)
amp_3 = Amplitude(Vector=X_2, Amplitude=addition)

addition_2 = Addition(A=multiplication_2, B=subtraction_2)
Y_2 = UnitY(Factor=1)
amp_4 = Amplitude(Vector=Y_2, Amplitude=addition_2)

# ---- group: RESULTADO
move_5 = Move(Geometry=rotax.Geometry, Motion=amp_3)  # -> Geometry, Transform

# ----
move_6 = Move(Geometry=rotax_2.Geometry, Motion=amp_4)  # -> Geometry, Transform
