# Grasshopper definition 2017-2-01_SCRIPT VOLUMEN + WAFFLING.gh (Grasshopper 0.9.76)

# ---- group: GEOMETRIAS BASE
geo = Geometry(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)
geo_2 = Geometry(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)
geo_3 = Geometry(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)
geo_4 = Geometry(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)
geo_5 = Geometry(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)
geo_6 = Geometry(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)
geo_7 = Geometry(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)
geo_8 = Geometry(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)
geo_9 = Geometry(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)
geo_10 = Geometry(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)
geo_11 = Geometry(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)
geo_12 = Geometry(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)

# ----
boxprop = BoxProperties(Box=geo)  # -> Center, Diagonal, Area, Volume, Degeneracy
boxprop_2 = BoxProperties(Box=geo_9)  # -> Center, Diagonal, Area, Volume, Degeneracy
boxprop_3 = BoxProperties(Box=geo_5)  # -> Center, Diagonal, Area, Volume, Degeneracy

# ---- group: VOLUMEN A SUSTRAER (CENTRO DE SOMBRILLAS)
scale = Scale(Geometry=[geo_12, geo_10, geo_11, geo_9], Center=boxprop_2.Center, Factor=0.5)  # -> Geometry, Transform
scale_2 = Scale(Geometry=[geo_8, geo_6, geo_7, geo_5], Center=boxprop_3.Center, Factor=0.5)  # -> Geometry, Transform
scale_3 = Scale(Geometry=[geo_4, geo_2, geo_3, geo], Center=boxprop.Center, Factor=0.5)  # -> Geometry, Transform
item = ListItem(List=scale.Geometry, Index=0, Wrap=True)  # -> Item, Item1, Item2, Item3
item_2 = ListItem(List=scale_3.Geometry, Index=0, Wrap=True)  # -> Item, Item1, Item2, Item3
item_3 = ListItem(List=scale_2.Geometry, Index=0, Wrap=True)  # -> Item, Item1, Item2, Item3
loft = Loft(
    Curves=[item.Item, item.Item1, item.Item2, item.Item3],
    Options={Adjust=False, Closed=False, LoftEnds=0, LoftSimp=0, LoftType=0, Rebuild=10, Refit=0.01})
loft_2 = Loft(
    Curves=[item_2.Item, item_2.Item1, item_2.Item2, item_2.Item3],
    Options={Adjust=False, Closed=False, LoftEnds=0, LoftSimp=0, LoftType=0, Rebuild=10, Refit=0.01})
loft_3 = Loft(
    Curves=[item_3.Item, item_3.Item1, item_3.Item2, item_3.Item3],
    Options={Adjust=False, Closed=False, LoftEnds=0, LoftSimp=0, LoftType=0, Rebuild=10, Refit=0.01})
flip = Flip(Surface=loft_3)  # -> Surface, Result
flip_2 = Flip(Surface=loft)  # -> Surface, Result
flip_3 = Flip(Surface=loft_2)  # -> Surface, Result
Z = UnitZ(Factor=1)
cap = CapHoles(Brep=flip_2.Surface)
cap_2 = CapHoles(Brep=flip_3.Surface)
cap_3 = CapHoles(Brep=flip.Surface)
move = Move(Geometry=[cap, cap_2, cap_3], Motion=Z)  # -> Geometry, Transform
item_4 = ListItem(List=move.Geometry, Index=0, Wrap=True)  # -> Item, Item1, Item2

# ---- group: SUPERFICIE INFERIOR
loft_4 = Loft(
    Curves=[geo_8, geo_6, geo_7, geo_5],
    Options={Adjust=False, Closed=False, LoftEnds=0, LoftSimp=0, LoftType=0, Rebuild=10, Refit=0.01})
loft_5 = Loft(
    Curves=[geo_12, geo_10, geo_11, geo_9],
    Options={Adjust=False, Closed=False, LoftEnds=0, LoftSimp=0, LoftType=0, Rebuild=10, Refit=0.01})
loft_6 = Loft(
    Curves=[geo_4, geo_2, geo_3, geo],
    Options={Adjust=False, Closed=False, LoftEnds=0, LoftSimp=0, LoftType=0, Rebuild=10, Refit=0.01})
bbx = BrepBrep(BrepA=loft_6, BrepB=loft_4)  # -> Curves, Points
bbx_2 = BrepBrep(BrepA=loft_5, BrepB=loft_6)  # -> Curves, Points
srfsplit = SurfaceSplit(Surface=loft_4, Curves=bbx.Curves)
srfsplit_2 = SurfaceSplit(Surface=loft_5, Curves=bbx_2.Curves)
srfsplit_3 = SurfaceSplit(Surface=loft_6, Curves=[bbx_2.Curves, bbx.Curves])
item_5 = ListItem(List=srfsplit, Index=expr("x", 0), Wrap=True)
item_6 = ListItem(List=srfsplit_3, Index=expr("x+1", 0), Wrap=True)
item_7 = ListItem(List=srfsplit_2, Index=expr("X+1", 0), Wrap=True)
edges = BrepEdges(Brep=item_7)  # -> Naked, Interior, NonManifold
sunion = SolidUnion(Breps=[item_7, item_6, item_5])

# ---- group: VOLUMEN LLENO
cap_4 = CapHoles(Brep=sunion)

# ---- group: VOLUMEN FINAL PABELLON
sdiff = SolidDifference(BrepsA=cap_4, BrepsB=[item_4.Item, item_4.Item1, item_4.Item2])

# ----
tolerancia_espesor_cartópn = Slider(0, range=0..2)

# ---- group: PARÁMETROS MODELO FISICO
distancia_contour_mm = Slider(12, range=0..30)
espesor_cartón = Slider(2, range=0..10)
escala_1 = Slider(250, range=0..1000)

# ----
addition = Addition(A=espesor_cartón, B=tolerancia_espesor_cartópn)
geo_13 = Geometry(sdiff)

# ---- group: SECCIONADO EN X y Y
bbox = BoundingBox(Content=geo_13, Plane=PlaneXY(0, 0, 0))  # -> Box, Box_2
debrep = DeconstructBrep(Brep=bbox.Box)  # -> Faces, Edges, Vertices
item_8 = ListItem(List=debrep.Vertices, Index=0, Wrap=True)
multiplication = Multiplication(A=distancia_contour_mm, B=escala_1)
Y = UnitY(Factor=1)
X = UnitX(Factor=1)
contour = Contour(Shape=geo_13, Point=item_8, Direction=Y, Distance=multiplication)  # -> flatten(Contours)
contour_2 = Contour(Shape=geo_13, Point=item_8, Direction=X, Distance=multiplication)  # -> flatten(Contours)
boundary = BoundarySurfaces(Edges=contour_2)  # -> graft(Surfaces)
boundary_2 = BoundarySurfaces(Edges=contour)  # -> graft(Surfaces)

# ---- group: ENCASTRES / 1. PUNTOS MEDIO Y EXTREMOS
bbx_3 = BrepBrep(BrepA=boundary, BrepB=flatten(boundary_2))  # -> flatten(Curves), Points
x_tremez = Extremes(Curve=bbx_3.Curves, Plane=PlaneXY(0, 0, 0))  # -> Highest, Lowest
curvepoint = PointOnCurve(bbx_3.Curves, parameter=0.5)

# ---- group: ENCASTRES / 2. LINEAS CENTRO ENCASTRER
ln = Line(StartPoint=curvepoint, EndPoint=x_tremez.Lowest)
ln_2 = Line(StartPoint=x_tremez.Highest, EndPoint=curvepoint)

# ---- group: ENCASTRES / ESPESOR CARTÓN ESCALADO
multiplication_2 = Multiplication(A=addition, B=escala_1)

# ---- group: ENCASTRES / 3. TUBOS CON RADIO DEL ESPESOR DEL CARTÓN + TOLERANCIA
pipe = Pipe(Curve=ln, Radius=expr("x/2", multiplication_2), Caps=0)  # -> flatten(Pipe)
pipe_2 = Pipe(Curve=ln_2, Radius=expr("x/2", multiplication_2), Caps=0)  # -> flatten(Pipe)
cap_5 = CapHoles(Brep=pipe)
cap_6 = CapHoles(Brep=pipe_2)
scale_nu = ScaleNU(Geometry=cap_6, Plane=curvepoint, ScaleX=1, ScaleY=1, ScaleZ=2)  # -> Geometry, Transform
scale_nu_2 = ScaleNU(Geometry=cap_5, Plane=curvepoint, ScaleX=1, ScaleY=1, ScaleZ=2)  # -> Geometry, Transform

# ---- group: ENCASTRES / 4. PLANOS DE ENCASTRE
contour_3 = Contour(Shape=scale_nu.Geometry, Point=item_8, Direction=X, Distance=multiplication)  # -> flatten(Contours)
contour_4 = Contour(Shape=scale_nu_2.Geometry, Point=item_8, Direction=Y, Distance=multiplication)  # -> flatten(Contours)
boundary_3 = BoundarySurfaces(Edges=contour_3)
boundary_4 = BoundarySurfaces(Edges=contour_4)

# ---- group: 5. SUSTRACCION ENCASTRES
extr = Extrude(Base=flatten(boundary_2), Direction=Y)
# AVERIGUAR EN ALGÚN PUNTO DEL FUTURO SI ES POSIBLE SUSTRAER LOS ENCASTRES DIRECTAMENTE COMO REGIONES, SIN EXTRUIR. ESE PUEDE SER UN PUNTO IMPORTANTE DE OPTIMIZACIÓN DEL SCRIPT
extr_2 = Extrude(Base=flatten(boundary), Direction=X)
extr_3 = Extrude(Base=boundary_3, Direction=X)
extr_4 = Extrude(Base=boundary_4, Direction=Y)
sdiff_2 = SolidDifference(BrepsA=extr_2, BrepsB=extr_3)
sdiff_3 = SolidDifference(BrepsA=extr, BrepsB=extr_4)

# ---- group: PIEZAS PARA DESPIECE
contour_5 = Contour(Shape=sdiff_2, Point=item_8, Direction=X, Distance=multiplication)
contour_6 = Contour(Shape=sdiff_3, Point=item_8, Direction=Y, Distance=multiplication)

# ---- group: PIEZAS PARA VISUALIZACIÓN DE MODELO VIRTUAL
boundary_5 = BoundarySurfaces(Edges=contour_5)
boundary_6 = BoundarySurfaces(Edges=contour_6)
amp = Amplitude(Vector=X, Amplitude=expr("x/2", multiplication_2))
amp_2 = Amplitude(Vector=Y, Amplitude=expr("x/2", multiplication_2))
rev = Reverse(Vector=amp)
rev_2 = Reverse(Vector=amp_2)
extr_5 = Extrude(Base=boundary_5, Direction=amp)
extr_6 = Extrude(Base=boundary_6, Direction=amp_2)
extr_7 = Extrude(Base=boundary_5, Direction=rev)
extr_8 = Extrude(Base=boundary_6, Direction=rev_2)
sunion_2 = SolidUnion(Breps=[extr_8, extr_6])
sunion_3 = SolidUnion(Breps=[extr_7, extr_5])
fmerge = MergeFaces(Brep=sunion_2)  # -> Breps, Before, After
fmerge_2 = MergeFaces(Brep=sunion_3)  # -> Breps, Before, After

# ---- group: PIEZA PLANO TECHO
number_slider = Slider(3, range=0..100)
debrep_2 = DeconstructBrep(Brep=geo_13)  # -> Faces, Edges, Vertices

# ---- group: PIEZA PLANO TECHO / Techo
item_9 = ListItem(List=debrep_2.Faces, Index=number_slider, Wrap=True)

# ---- group: PIEZA PLANO TECHO (continued)
edges_2 = BrepEdges(Brep=item_9)  # -> Naked, Interior, NonManifold
