# Grasshopper definition 2020-1-01_SCRIPT MURO CALADO.gh (Grasshopper 0.9.76)
# plug-ins: PTComponentLibrary

number_slider = Slider(60, range=0..100)
geo = Geometry(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)
num = Number(expr("x/100", number_slider))
num_2 = Number(Slider(291, range=0..291))
Z = UnitZ(Factor=1)
amp = Amplitude(Vector=Z, Amplitude=num)
move = Move(Geometry=geo, Motion=amp)  # -> Geometry, Transform
grosor_mortero_de_pega = Slider(2, range=0..10, expression="x/100")
num_3 = Number(expr("100*x", grosor_mortero_de_pega))
geo_2 = Geometry(move.Geometry)
end = EndPoints(Curve=geo_2)  # -> Start, End
B = LadrilloToleteGranformatoANCHO(expr("x/100", 11.5))
num_4 = Number(expr("100*x", B))
Z_2 = LadrilloToleteGranformatoALTO(expr("x/100", 39))
h = Number(expr("x/100", 5))
cluster = Cluster(origin=end.Start, ladrillo_tolete_granformato_ancho=B, ladrillo_tolete_granformato_alto=Z_2, altura=h)  # -> G, distancia_1, distancia_2
num_5 = Number(cluster.distancia_1)
abs = Absolute(Value=cluster.distancia_1)
Z_3 = UnitZ(Factor=B)
ptdividedis = DivideDistance(Curve=geo_2, Distance=abs, AddEnd=False)
lng = ListLength(List=ptdividedis)
subtraction = Subtraction(A=lng, B=Slider(0, range=0..1))
series = Series(Start=0, Step=1, Count=subtraction)
item = ListItem(List=ptdividedis, Index=series, Wrap=True)
panel = Panel("164s")
dispatch = Dispatch(List=item, DispatchPattern=[True, False])  # -> ListA, ListB
move_2 = Move(Geometry=dispatch.ListB, Motion=Z_3)  # -> Geometry, Transform
move_3 = Move(Geometry=dispatch.ListA, Motion=Z_3)  # -> Geometry, Transform
shift = ShiftList(List=dispatch.ListA, Shift=1, Wrap=True)
shift_2 = ShiftList(List=move_3.Geometry, Shift=1, Wrap=True)

# ---- group: HILERA 1
pt = Point(move_2.Geometry)
pt_2 = Point(move_3.Geometry)
pt_3 = Point(move_2.Geometry)
pt_4 = Point(shift_2)
ln = Line(StartPoint=pt_2, EndPoint=pt)
curvepoint = PointOnCurve(ln, parameter=0.5)
ln_2 = Line(StartPoint=pt_4, EndPoint=pt_3)
curvepoint_2 = PointOnCurve(ln_2, parameter=0.5)
xy = XYPlane(Origin=curvepoint)
xy_2 = XYPlane(Origin=curvepoint_2)
vec2pt = Vector2Pt(PointA=pt_4, PointB=pt_3, Unitize=False)  # -> Vector, Length
rotate = Rotate(Geometry=ln, Angle=1.570796327, Plane=xy)  # -> Geometry, Transform
rotate_2 = Rotate(Geometry=ln_2, Angle=1.570796327, Plane=xy_2)  # -> Geometry, Transform
cluster_2 = Cluster(
    dirección=vec2pt.Vector,
    origin=pt_4,
    ladrillo_tolete_granformato_ancho=expr("x/100", 11.5),
    ladrillo_tolete_granformato_alto=expr("x/100", 39),
    altura=expr("x/100", 5))  # -> G, distancia_1, distancia_2
end_2 = EndPoints(Curve=rotate.Geometry)  # -> Start, End
end_3 = EndPoints(Curve=rotate_2.Geometry)  # -> Start, End
vec2pt_2 = Vector2Pt(PointA=curvepoint, PointB=end_2.End, Unitize=False)  # -> Vector, Length
vec2pt_3 = Vector2Pt(PointA=curvepoint_2, PointB=end_3.End, Unitize=False)  # -> Vector, Length
vec2pt_4 = Vector2Pt(PointA=curvepoint_2, PointB=end_3.Start, Unitize=False)  # -> Vector, Length
amp_2 = Amplitude(Vector=vec2pt_2.Vector, Amplitude=expr("x/2", cluster.distancia_1))
amp_3 = Amplitude(Vector=vec2pt_4.Vector, Amplitude=expr("x/2", cluster.distancia_2))
rev = Reverse(Vector=vec2pt_2.Vector)
amp_4 = Amplitude(Vector=vec2pt_3.Vector, Amplitude=expr("x/2", cluster.distancia_2))
move_4 = Move(Geometry=curvepoint, Motion=amp_2)  # -> Geometry, Transform
cluster_metros = Cluster(
    dirección=rev,
    origin=move_4.Geometry,
    ladrillo_tolete_granformato_ancho=expr("x/100", 11.5),
    ladrillo_tolete_granformato_alto=expr("x/100", 39),
    altura=expr("x/100", 5))  # -> G, distancia_1, distancia_2
move_5 = Move(Geometry=cluster_2.G, Motion=amp_3)  # -> Geometry, Transform
move_6 = Move(Geometry=cluster_2.G, Motion=amp_4)  # -> Geometry, Transform

pt_5 = Point(dispatch.ListB)
pt_6 = Point(shift)
pt_7 = Point(dispatch.ListB)
pt_8 = Point(dispatch.ListA)
ln_3 = Line(StartPoint=pt_6, EndPoint=pt_5)
curvepoint_3 = PointOnCurve(ln_3, parameter=0.5)
ln_4 = Line(StartPoint=pt_8, EndPoint=pt_7)
curvepoint_4 = PointOnCurve(ln_4, parameter=0.5)
xy_3 = XYPlane(Origin=curvepoint_3)
xy_4 = XYPlane(Origin=curvepoint_4)
vec2pt_5 = Vector2Pt(PointA=pt_8, PointB=pt_7, Unitize=False)  # -> Vector, Length
rotate_3 = Rotate(Geometry=ln_3, Angle=1.570796327, Plane=xy_3)  # -> Geometry, Transform
rotate_4 = Rotate(Geometry=ln_4, Angle=1.570796327, Plane=xy_4)  # -> Geometry, Transform
cluster_3 = Cluster(
    dirección=vec2pt_5.Vector,
    origin=pt_8,
    ladrillo_tolete_granformato_ancho=expr("x/100", 11.5),
    ladrillo_tolete_granformato_alto=expr("x/100", 39),
    altura=expr("x/100", 5))  # -> G, distancia_1, distancia_2
end_4 = EndPoints(Curve=rotate_3.Geometry)  # -> Start, End
end_5 = EndPoints(Curve=rotate_4.Geometry)  # -> Start, End
vec2pt_6 = Vector2Pt(PointA=curvepoint_3, PointB=end_4.End, Unitize=False)  # -> Vector, Length
vec2pt_7 = Vector2Pt(PointA=curvepoint_4, PointB=end_5.End, Unitize=False)  # -> Vector, Length
vec2pt_8 = Vector2Pt(PointA=curvepoint_4, PointB=end_5.Start, Unitize=False)  # -> Vector, Length
amp_5 = Amplitude(Vector=vec2pt_6.Vector, Amplitude=expr("x/2", cluster.distancia_1))
amp_6 = Amplitude(Vector=vec2pt_8.Vector, Amplitude=expr("x/2", cluster.distancia_2))
rev_2 = Reverse(Vector=vec2pt_6.Vector)
amp_7 = Amplitude(Vector=vec2pt_7.Vector, Amplitude=expr("x/2", cluster.distancia_2))
move_7 = Move(Geometry=curvepoint_3, Motion=amp_5)  # -> Geometry, Transform
cluster_4 = Cluster(
    dirección=rev_2,
    origin=move_7.Geometry,
    ladrillo_tolete_granformato_ancho=expr("x/100", 11.5),
    ladrillo_tolete_granformato_alto=expr("x/100", 39),
    altura=expr("x/100", 5))  # -> G, distancia_1, distancia_2
move_8 = Move(Geometry=cluster_3.G, Motion=amp_6)  # -> Geometry, Transform
move_9 = Move(Geometry=cluster_3.G, Motion=amp_7)  # -> Geometry, Transform

# ----
num_6 = Number(expr("2*x", grosor_mortero_de_pega))
num_7 = Number(grosor_mortero_de_pega)
geo_3 = Geometry(graft([move_8.Geometry, move_9.Geometry, cluster_4.G]))
geo_4 = Geometry(graft([move_5.Geometry, move_6.Geometry, cluster_metros.G]))
Z_4 = UnitZ(Factor=1)
Z_5 = UnitZ(Factor=1)
Z_6 = UnitZ(Factor=1)
Z_7 = UnitZ(Factor=1)
amp_8 = Amplitude(Vector=Z_4, Amplitude=num_7)
amp_9 = Amplitude(Vector=Z_5, Amplitude=num_6)
num_8 = Number(grosor_mortero_de_pega)
Z_8 = UnitZ(Factor=1)
Z_9 = UnitZ(Factor=1)
amp_10 = Amplitude(Vector=Z_8, Amplitude=expr("-x", num_8))
amp_11 = Amplitude(Vector=Z_9, Amplitude=num_8)
num_9 = Number(B)
addition = Addition(A=num_8, B=num_9)
Z_10 = UnitZ(Factor=1)
amp_12 = Amplitude(Vector=Z_10, Amplitude=expr("-x", addition))

# ---- group: BASE
num_10 = Number(expr("x/2", num_5))
num_11 = Number(expr("-x/2", num_5))
offset = Offset(Curve=geo, Distance=[num_10, num_11], Plane=PlaneXY(0, 0, 0), Corners=1)  # -> flatten(Curve)
Z_11 = UnitZ(Factor=1)
loft = Loft(Options={Adjust=False, Closed=False, LoftEnds=0, LoftSimp=0, LoftType=0, Rebuild=10, Refit=0.01})
amp_13 = Amplitude(Vector=Z_11, Amplitude=expr("x/100", number_slider))

# ----
end_6 = EndPoints(Curve=offset)  # -> Start, End
entwine = Entwine(Branch00=end_6.Start, Branch01=end_6.End, FlattenInputs=True)
flip = FlipMatrix(Data=entwine)
bang = ExplodeTree(Data=flip)  # -> Branch0, Branch1
ln_5 = Line(StartPoint=bang.Branch0, EndPoint=bang.Branch1)  # -> flatten(Line)
boundary = BoundarySurfaces(Edges=[ln_5, offset])

# ---- group: BASE (continued)
extr = Extrude(Base=boundary, Direction=amp_13)

# ----
geo_5 = Geometry(extr)
move_10 = Move(Geometry=geo_5, Motion=Vector(0, 0, 0.1))  # -> Geometry, Transform
geo_6 = Geometry(extr)
mesh = MeshBrep(
    Brep=geo_6,
    Settings={GridMaxCount=0, GridMinCount=16, JaggedSeams=False, MaxEdgeLength=0, MinEdgeLength=0.0001, MinTolerance=0, Refine=True, RefineAngle=0, RelativeTolerance=0.65, SimplePlanes=True, Tolerance=0})

addition_2 = Addition(A=num_4, B=num_3)
subtraction_2 = Subtraction(A=num_2, B=addition_2)
subtraction_3 = Subtraction(A=subtraction_2, B=num)
subtraction_4 = Subtraction(A=subtraction_3, B=addition_2)
multiplication = Multiplication(A=addition_2, B=2)
integer_division = IntegerDivision(A=subtraction_3, B=multiplication)
integer_division_2 = IntegerDivision(A=subtraction_4, B=multiplication)
series_2 = Series(Start=1, Step=1, Count=integer_division)
series_3 = Series(Start=1, Step=1, Count=integer_division_2)

num_12 = Number(expr("x/100", multiplication))

multiplication_2 = Multiplication(A=num_12, B=series_2)
multiplication_3 = Multiplication(A=num_12, B=series_3)

num_13 = Number(multiplication_2)
num_14 = Number(multiplication_3)
amp_14 = Amplitude(Vector=Z_6, Amplitude=num_13)
amp_15 = Amplitude(Vector=Z_7, Amplitude=num_14)

# ---- group: LADRILLOS FINAL
move_11 = Move(Geometry=geo_3, Motion=amp_8)  # -> Geometry, Transform
move_12 = Move(Geometry=geo_4, Motion=amp_9)  # -> Geometry, Transform
move_13 = Move(Geometry=move_11.Geometry, Motion=amp_14)  # -> Geometry, Transform
move_14 = Move(Geometry=move_12.Geometry, Motion=amp_15)  # -> Geometry, Transform

# ---- group: CARAS SUPERIOR E INFERIOR DE LADRILLO
geo_7 = Geometry(flatten(move_11.Geometry))
debrep = DeconstructBrep(Brep=geo_7)  # -> Faces, Edges, Vertices
item_2 = ListItem(List=debrep.Faces, Index=Slider(1, range=0..25), Wrap=True)
item_3 = ListItem(List=debrep.Faces, Index=Slider(8, range=0..25), Wrap=True)

geo_8 = Geometry(flatten(move_12.Geometry))
debrep_2 = DeconstructBrep(Brep=geo_8)  # -> Faces, Edges, Vertices
item_4 = ListItem(List=debrep_2.Faces, Index=Slider(1, range=0..25), Wrap=True)
item_5 = ListItem(List=debrep_2.Faces, Index=Slider(8, range=0..25), Wrap=True)

# ----
geo_9 = Geometry(item_3)
geo_10 = Geometry(item_4)
extr_2 = Extrude(Base=item_2, Direction=amp_10)
move_15 = Move(Geometry=geo_9, Motion=amp_11)  # -> Geometry, Transform
bbx = BrepBrep(BrepA=flatten(move_15.Geometry), BrepB=geo_10)  # -> Curves, Points
boundary_2 = BoundarySurfaces(Edges=bbx.Curves)
vec = Vector(amp_15)
vec_2 = Vector(amp_14)

debrep_3 = DeconstructBrep(Brep=extr_2)  # -> Faces, Edges, Vertices
item_6 = ListItem(List=debrep_3.Vertices, Index=0, Wrap=True)
cluster_5 = Cluster_2()
brepsinc = PointInBreps(Brep=move_10.Geometry, Point=item_6, Strict=False)  # -> Inside, Index

# ---- group: MORTERO PEGA ABAJO
sint = SolidIntersection(BrepsA=extr_2, BrepsB=move_10.Geometry)
keysearch = KeyValueSearch(Keys=brepsinc.Inside, Values=extr_2, Search=Toggle(True))

# ----
mesh_2 = Mesh([keysearch, sint])
geo_11 = Geometry(flatten([move_13.Geometry, move_11.Geometry, move_14.Geometry, move_12.Geometry]))
mesh_3 = MeshBrep(
    Brep=geo_11,
    Settings={GridMaxCount=0, GridMinCount=16, JaggedSeams=False, MaxEdgeLength=0, MinEdgeLength=0.0001, MinTolerance=0, Refine=True, RefineAngle=0, RelativeTolerance=0.65, SimplePlanes=True, Tolerance=0})

# ---- group: MORTEROS PEGA
extr_3 = Extrude(Base=boundary_2, Direction=amp_10)
move_16 = Move(Geometry=extr_3, Motion=vec)  # -> Geometry, Transform

# ----
move_17 = Move(Geometry=extr_3, Motion=amp_12)  # -> Geometry, Transform

# ---- group: MORTEROS PEGA (continued)
move_18 = Move(Geometry=move_17.Geometry, Motion=vec_2)  # -> Geometry, Transform

# ----
geo_12 = Geometry(flatten([move_18.Geometry, extr_3, move_16.Geometry, keysearch, sint]))
mesh_4 = MeshBrep(
    Brep=geo_12,
    Settings={GridMaxCount=0, GridMinCount=16, JaggedSeams=False, MaxEdgeLength=0, MinEdgeLength=0.0001, MinTolerance=0, Refine=True, RefineAngle=0, RelativeTolerance=0.65, SimplePlanes=True, Tolerance=0})

# ==== cluster Cluster
origin = ClusterInput()  # Punto de origen
geo = Geometry(origin)
dirección = ClusterInput()  # Ángulo del ladrillo. Defaults to Y
vec = Vector(dirección)
number_slider = Slider(0, range=0..1)
altura = ClusterInput()
num = Number(altura)

# ---- group: PLANO
pt = Point(geo)
xy = XYPlane(Origin=pt)
xz = XZPlane(Origin=pt)
deplane = DeconstructPlane(Plane=xz)  # -> Origin, XAxis, YAxis, ZAxis

# ----
align = AlignPlane(Plane=xy, Direction=vec)  # -> Plane, Angle

# ---- group: PLANO (continued)
deplane_2 = DeconstructPlane(Plane=align.Plane)  # -> Origin, XAxis, YAxis, ZAxis
pl = ConstructPlane(Origin=pt, XAxis=deplane_2.ZAxis, YAxis=deplane_2.XAxis)

# ---- group: RECTÁNGULO CONTORNO EXTERIOR
ladrillo_tolete_granformato_ancho = ClusterInput()
ladrillo_tolete_granformato_alto = ClusterInput()
b_cm = Number(ladrillo_tolete_granformato_ancho)
z_cm = Number(ladrillo_tolete_granformato_alto)
rectangle = Rectangle(Plane=pl, XSize=b_cm, YSize=z_cm, Radius=number_slider)  # -> Rectangle, Length

# ----
vec_2 = Vector(deplane_2.ZAxis)
vec_3 = Vector(deplane_2.YAxis)
vec_4 = Vector(deplane_2.XAxis)
geo_2 = Geometry(rectangle.Rectangle)
amp = Amplitude(Vector=vec_3, Amplitude=expr("x/2", num))
amp_2 = Amplitude(Vector=vec_3, Amplitude=expr("-x", num))

# ---- group: HUECO ALIGERAMIENTO
number_slider_2 = Slider(2, range=1..3, expression="x/100")

amp_3 = Amplitude(Vector=vec_4, Amplitude=number_slider_2)
amp_4 = Amplitude(Vector=vec_2, Amplitude=number_slider_2)
move = Move(Geometry=pt, Motion=amp_3)  # -> Geometry, Transform
move_2 = Move(Geometry=move.Geometry, Motion=amp_4)  # -> Geometry, Transform

# ---- group: HUECO ALIGERAMIENTO / LARGO HUECO ALIGERAMIENTO
ancho_aligeramiento_central = Slider(1.5, range=1..3, expression="x/100")
multiplication = Multiplication(A=number_slider_2, B=6)
subtraction = Subtraction(A=z_cm, B=multiplication)
subtraction_2 = Subtraction(A=subtraction, B=ancho_aligeramiento_central)
division = Division(A=subtraction_2, B=4)

# ---- group: HUECO ALIGERAMIENTO / ANCHO HUECO ALIGERAMIENTO
multiplication_2 = Multiplication(A=number_slider_2, B=2)
subtraction_3 = Subtraction(A=b_cm, B=multiplication_2)

# ---- group: HUECO ALIGERAMIENTO (continued)
pl_2 = ConstructPlane(Origin=move_2.Geometry, XAxis=vec_4, YAxis=vec_2)
rectangle_2 = Rectangle(Plane=pl_2, XSize=division, YSize=subtraction_3, Radius=number_slider)  # -> Rectangle, Length

addition = Addition(A=division, B=number_slider_2)
amp_5 = Amplitude(Vector=vec_4, Amplitude=addition)
move_3 = Move(Geometry=rectangle_2.Rectangle, Motion=amp_5)  # -> Geometry, Transform

# ---- group: MIRROR HUECOS ALIGERAMIENTO
division_2 = Division(A=z_cm, B=2)
amp_6 = Amplitude(Vector=vec_4, Amplitude=division_2)
move_4 = Move(Geometry=deplane_2.Origin, Motion=amp_6)  # -> Geometry, Transform
pl_3 = PlaneNormal(Origin=move_4.Geometry, ZAxis=vec)
mirror = Mirror(Geometry=move_3.Geometry, Plane=pl_3)  # -> Geometry, Transform
mirror_2 = Mirror(Geometry=rectangle_2.Rectangle, Plane=pl_3)  # -> Geometry, Transform

# ----
multiplication_3 = Multiplication(A=division, B=3)
multiplication_4 = Multiplication(A=number_slider_2, B=4)
multiplication_5 = Multiplication(A=division, B=2)
multiplication_6 = Multiplication(A=number_slider_2, B=3)
ma = MassAddition(Input=[ancho_aligeramiento_central, multiplication_4, multiplication_3])  # -> Result, PartialResults
ma_2 = MassAddition(Input=[ancho_aligeramiento_central, multiplication_6, multiplication_5])  # -> Result, PartialResults
distancia_1 = ClusterOutput(ma.Result)  # Distancia entre vacíos, para ladrillos longitudinales
distancia_2 = ClusterOutput(ma_2.Result)  # Distancia entre puntos sólidos, para los ladrillos transversales
division_3 = Division(A=division, B=2)
addition_2 = Addition(A=number_slider_2, B=division_3)
amp_7 = Amplitude(Vector=vec, Amplitude=expr("-x", addition_2))

# ---- group: HUECO ALIGERAMIENTO CENTRAL
multiplication_7 = Multiplication(A=number_slider_2, B=3)
multiplication_8 = Multiplication(A=division, B=2)
addition_3 = Addition(A=multiplication_7, B=multiplication_8)

amp_8 = Amplitude(Vector=vec, Amplitude=addition_3)
amp_9 = Amplitude(Vector=vec_2, Amplitude=number_slider_2)
move_5 = Move(Geometry=pt, Motion=amp_8)  # -> Geometry, Transform
move_6 = Move(Geometry=move_5.Geometry, Motion=amp_9)  # -> Geometry, Transform

pl_4 = ConstructPlane(Origin=move_6.Geometry, XAxis=vec_2, YAxis=vec_4)
rectangle_3 = Rectangle(Plane=pl_4, XSize=subtraction_3, YSize=ancho_aligeramiento_central, Radius=number_slider)  # -> Rectangle, Length

# ---- group: REAGRUPAR LOS HUECOS PARA QUE QUEDEN x LISTAS DE 5 HUECOS (LOS HUECOS DE CADA LADRILLO)
lng = ListLength(List=geo_2)
series = Series(Start=0, Step=1, Count=lng)
multiplication_9 = Multiplication(A=series, B=6)
multiplication_10 = Multiplication(A=series, B=6)
_0 = Number(0)
_4 = Number(5)
addition_4 = Addition(A=multiplication_9, B=_0)
addition_5 = Addition(A=multiplication_10, B=_4)
dom = ConstructDomain(DomainStart=addition_4, DomainEnd=addition_5)
weave = Weave(
    Pattern=[0, 1, 2, 3, 4, 5],
    Stream0=rectangle_2.Rectangle,
    Stream1=move_3.Geometry,
    Stream2=rectangle_3.Rectangle,
    Stream3=mirror.Geometry,
    Stream4=mirror_2.Geometry,
    Stream5=geo_2,
    NullGaps=False)
subset = SubList(List=weave, Domain=dom, Wrap=True)  # -> List, Index

# ----
boundary = BoundarySurfaces(Edges=subset.List)  # -> flatten(Surfaces)
panel = Panel(boundary)
move_7 = Move(Geometry=boundary, Motion=amp)  # -> Geometry, Transform
extr = Extrude(Base=move_7.Geometry, Direction=amp_2)
move_8 = Move(Geometry=extr, Motion=amp_7)  # -> Geometry, Transform
G = ClusterOutput(move_8.Geometry)

# ==== cluster Cluster_2
geo = ClusterInput()
geo_2 = Geometry(geo)
debox = DeconstructBox(Box=geo_2)  # -> Plane, X, Y, Z
cell = ClusterInput()
debox_2 = DeconstructBox(Box=cell)  # -> Plane, X, Y, Z
dedomain = DeconstructDomain(Domain=debox_2.Z)  # -> Start, End
dedomain_2 = DeconstructDomain(Domain=debox_2.Y)  # -> Start, End
dedomain_3 = DeconstructDomain(Domain=debox_2.X)  # -> Start, End
dedomain_4 = DeconstructDomain(Domain=debox.Z)  # -> Start, End
dedomain_5 = DeconstructDomain(Domain=debox.Y)  # -> Start, End
dedomain_6 = DeconstructDomain(Domain=debox.X)  # -> Start, End
subtraction = Subtraction(A=dedomain.End, B=dedomain.Start)
subtraction_2 = Subtraction(A=dedomain_2.End, B=dedomain_2.Start)
subtraction_3 = Subtraction(A=dedomain_3.End, B=dedomain_3.Start)
subtraction_4 = Subtraction(A=dedomain_4.End, B=dedomain_4.Start)
subtraction_5 = Subtraction(A=dedomain_5.End, B=dedomain_5.Start)
subtraction_6 = Subtraction(A=dedomain_6.End, B=dedomain_6.Start)
division = Division(A=subtraction_5, B=subtraction_2)
division_2 = Division(A=subtraction_6, B=subtraction_3)
division_3 = Division(A=subtraction_4, B=subtraction)
# esferas como geometría Y célula: 28s
# 
# puntos como geometría - esferas como célula:16s
pt = ConstructPoint(XCoordinate=dedomain_6.Start, YCoordinate=dedomain_5.Start, ZCoordinate=dedomain_4.Start)
box = DomainBox(Base=debox_2.Plane, X=debox_2.X, Y=debox_2.Y, Z=debox_2.Z)
arrbox = BoxArray(Geometry=pt, Cell=box, XCount=division_2, YCount=division, ZCount=division_3)  # -> Geometry, Transform
boxprop = BoxProperties(Box=arrbox.Geometry)  # -> Center, Diagonal, Area, Volume, Degeneracy
brepinc = PointInBrep(Brep=geo_2, Point=boxprop.Center, Strict=False)
panel = Panel(brepinc)
keysearch = KeyValueSearch(Keys=graft(brepinc), Values=graft(arrbox.Geometry), Search=Toggle(True))
geo_3 = Geometry(keysearch)
ptcloud = ClusterOutput(geo_3)
